# Grasshopper definition 01_pgn.gh (Grasshopper 0.9.76)
# plug-ins: Archsim, Ironbug

panel = Panel("C:\Users\Mingbo\Documents\GitHub\HoneybeeCSharp\doc\testFile\X_4.png")
panel_2 = Panel("C:\Users\Mingbo\Documents\GitHub\HoneybeeCSharp\doc\testFile\AcceleRad_test_IMG_Perspective_CPU@fc.TIF")
number_slider = Slider(0.5, range=0..1)
panel_3 = Panel("C:\Users\Mingbo\Documents\GitHub\HoneybeeCSharp\doc\testFile\indoor_view_h.HDR")
viewdata = ViewData(Scale=1)  # -> imagePath, Value
array_schedule = ArraySchedule(Hours=[1, 1, 1, 1, 1, 1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])
rec = DataRecorder(viewdata.Value, DataLimit=-10, RecordData=True)
panel_4 = Panel(viewdata.imagePath)
panel_5 = Panel(viewdata.Value)
panel_6 = Panel(rec)
clean = CleanTree(RemoveNulls=True, RemoveInvalid=True, RemoveEmpty=True, Tree=panel_6)
panel_7 = Panel(clean)
