# Grasshopper definition HVACSystemWorkflow.gh (Grasshopper 1.0.7)
# plug-ins: Ironbug.Grasshopper

objparams = Ironbug_ObjParams(
    MaximumValueofx="10",
    MaximumValueofy="35",
    MinimumValueofx="5",
    MinimumValueofy="24",
    DataFieldSetType="Ironbug.HVAC.Curves.IB_CurveBiquadratic_DataFieldSet")
objparams_2 = Ironbug_ObjParams(
    MaximumValueofx="10",
    MaximumValueofy="35",
    MinimumValueofx="5",
    MinimumValueofy="24",
    DataFieldSetType="Ironbug.HVAC.Curves.IB_CurveBiquadratic_DataFieldSet")
panel = Panel("""0.258
0.0389
-0.000217
0.0469
-0.000943
-0.000343""")
panel_2 = Panel("""0.222903
0.313387
0.46371""")
panel_3 = Panel("""0.934
-0.0582
0.0045
0.00243
0.000486
-0.00122""")
brep = Brep([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])
intersectmass = IntersectMass(x=brep)  # -> out, A; inputs x: list of Brep
# ---------- intersectmass: C# ----------
    var tolerance = Rhino.RhinoDoc.ActiveDoc.ModelAbsoluteTolerance;
    List<Brep> allOldBreps = x;

    if (x.Count() > 0)
    {
      var results = allOldBreps.AsParallel().AsOrdered().Select(b => SplitBrepWithBreps(b, allOldBreps, tolerance));
      A = results;
    }

    //SplitBrepWithBreps(x[0], x, tolerance);
# ---------- intersectmass: C# additional code ----------
  static Brep SplitBrepWithBreps(Brep CurrentBrep, List<Brep> AllBreps, double tolerance)
  {
    var currentBrep = CurrentBrep;
    var allBreps = AllBreps;

    foreach (Brep item in allBreps)
    {
      var  tempBrep = currentBrep.Split(item, tolerance);
      if (tempBrep.Count() > 0)
      {
        var newBrep = Rhino.Geometry.Brep.JoinBreps(tempBrep, tolerance);

        currentBrep = newBrep.First();
        currentBrep.Faces.ShrinkFaces();
      }
    }
    return currentBrep;

  }
# ---------- end intersectmass ----------
curvebiquadratic = Ironbug_CurveBiquadratic(Coefficients=panel, Parameters_=objparams_2)
curvebiquadratic_2 = Ironbug_CurveBiquadratic(Coefficients=panel_3, Parameters_=objparams)
curvequadratic = Ironbug_CurveQuadratic(Coefficients=panel_2)
honeybee = Honeybee_Honeybee()  # -> Vviiiiiiiiiizzz; plug-in component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
ladybug = Ladybug_Ladybug()  # -> Vviiiiiiiiiizzz; plug-in component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
number_slider = Slider(0.7, range=0..1)
panel_4 = Panel("""0.7
0.5
0.5
0.5
0.5
0.5""")
mass2zone = Honeybee_Masses2Zones(zoneMasses=flatten(intersectmass.A), maxRoofAngle=30, createHBZones=Toggle(True))  # -> readMe, HBZones; plug-in component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
curvebiquadratic_3 = Ironbug_CurveBiquadratic(Coefficients=panel_4)
chillerelec_adv = Ironbug_ChillerElectricEIR_Adv(
    CoolingCapacityFunctionOfTemperatureCurve=curvebiquadratic,
    ElectricInputToCoolingOutputRatioFunctionOfTemperatureCurve=curvebiquadratic_2,
    ElectricInputToCoolingOutputRatioFunctionOfPartLoadRatioCurve=curvequadratic)  # -> ChillerElectricEIR, ChillerElectricEIR_CondenserLoop
panel_5 = Panel("https://www.energyplus.net/weather-download/north_and_central_america_wmo_region_4/USA/NY/USA_NY_New.York-LaGuardia.AP.725030_TMY3/all")
glzparamlist = Honeybee_GlazingParametersList(northGlzParam=0, westGlzParam=0, southGlzParam=number_slider, eastGlzParam=number_slider)  # -> glzParamList; plug-in component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
objparams_3 = Ironbug_ObjParams(NormalizedBoilerEfficiencyCurve=curvebiquadratic_3, DataFieldSetType="Ironbug.HVAC.IB_BoilerHotWater_DataFields")
solveadjc = Honeybee_SolveAdjacencies(HBZones=flatten(mass2zone.HBZones), removeCurrentAdjc=False, findAdjc=Toggle(True))  # -> readMe, HBZonesWADJ; plug-in component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
chiller_aircooled = Ironbug_ChillerElectricEIR_AirCooled()
chillere = Ironbug_ChillerElectricEIR()  # -> ChillerElectricEIR, ChillerElectricEIR_CondenserLoop
glazingcreator = Honeybee_GlazingBasedOnRatio(HBObjects=solveadjc.HBZonesWADJ, glzRatio=glzparamlist, runIt=Toggle(True))  # -> readMe, HBObjWGLZ; plug-in component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
data = Data(flatten(glazingcreator.HBObjWGLZ))
brep_2 = Brep(flatten(data))

# ----
# Airloop
lng = ListLength(List=brep_2)
coilhw = Ironbug_CoilHeatingWater()  # -> AirSide_CoilHeatingWater, WaterSide_CoilHeatingWater
duplicate = Ironbug_Duplicate(Reference=coilhw.AirSide_CoilHeatingWater, Amount=lng)  # -> flatten(Objects), flatten(WaterSide_CoilHeatingWater)
objparams_4 = Ironbug_ObjParams(EconomizerControlType="DifferentialDryBulb", DataFieldSetType="Ironbug.HVAC.IB_ControllerOutdoorAir_DataFieldSet")
vavreheat = Ironbug_AirTerminalSingleDuctVAVReheat(HeatingCoil=duplicate.Objects)
oacontroller = Ironbug_OAController(Parameters=objparams_4)
objparams_5 = Ironbug_ObjParams(PressureRise="500", DataFieldSetType="Ironbug.HVAC.IB_FanVariableVolume_DataFields")
objparams_6 = Ironbug_ObjParams(
    AllOutdoorAirinCooling=Toggle(False),
    AllOutdoorAirinHeating=Toggle(False),
    CentralHeatingDesignSupplyAirTemperature="12.8",
    DataFieldSetType="Ironbug.HVAC.IB_SizingSystem_FieldSet")
oasystem = Ironbug_OutdoorAirSystem(Controller_=oacontroller)
coilcw = Ironbug_CoilCoolingWater()  # -> AirSide_CoilCoolingWater, WaterSide_CoilCoolingWater
coilhw_2 = Ironbug_CoilHeatingWater()  # -> AirSide_CoilHeatingWater, WaterSide_CoilHeatingWater
thermalzone = Ironbug_ThermalZone(HoneybeeZone=brep_2, AirTerminal_=vavreheat)
spscheduled = Ironbug_SetpointManagerScheduled(Temperature="12.8")
fanvariable = Ironbug_FanVariableVolume(Parameters=objparams_5)
szsystem = Ironbug_SizingSystem(Parameters=objparams_6)
branches = AirLoopBranches(Branch1=thermalzone)
merge = Merge(
    Data1=oasystem,
    Data2=coilcw.AirSide_CoilCoolingWater,
    Data3=coilhw_2.AirSide_CoilHeatingWater,
    Data4=fanvariable,
    Data5=spscheduled)
airloop = Ironbug_AirLoopHVAC(Supply=merge, Demand=branches, SizingSystem=szsystem)

epw_stat = Ladybug_OpenEPWAndSTATWeatherFiles(weatherFileURL=panel_5)  # -> epwFile, statFile; plug-in component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
graft = GraftTree(Tree=duplicate.WaterSide_CoilHeatingWater, IncludeEmptyLists=True, IncludeNullItems=True)

# ----
# Condenser water loop
clntower1 = Ironbug_CoolingTowerSingleSpeed()
pipeadiabatic = Ironbug_PipeAdiabatic()
spfollowoatemp = Ironbug_SetpointManagerFollowOutdoorAirTemperature(MinimumSetpointTemperature="6", OffsetTemperatureDifference="1.5")
pumpvariable = Ironbug_PumpVariableSpeed()
branches_2 = PlantBranches(Branch1=clntower1, Branch=pipeadiabatic)
branches_3 = PlantBranches(Branch1=chillere.ChillerElectricEIR_CondenserLoop)
dwloop = Ironbug_CondenserWaterPlantLoop(Supply=[pumpvariable, branches_2, spfollowoatemp], Demand=branches_3)

# ----
# Hot water loop
boilerhw = Ironbug_BoilerHotWater()
spscheduled_2 = Ironbug_SetpointManagerScheduled(Temperature="67")
pumpvariable_2 = Ironbug_PumpVariableSpeed()
branches_4 = PlantBranches(Branch1=boilerhw)
branches_5 = PlantBranches(Branch1=graft, Branch=coilhw_2.WaterSide_CoilHeatingWater)
hwloop = Ironbug_HotWaterPlantLoop(Supply=[pumpvariable_2, branches_4, spscheduled_2], Demand=branches_5)

panel_6 = Panel("80")

# ----
# Chilled water loop
panel_7 = Panel("6.7")
spscheduled_3 = Ironbug_SetpointManagerScheduled(Temperature=panel_7)
pumpvariable_3 = Ironbug_PumpVariableSpeed()
branches_6 = PlantBranches(Branch1=chillere.ChillerElectricEIR)
branches_7 = PlantBranches(Branch1=coilcw.WaterSide_CoilCoolingWater)
cwloop = Ironbug_ChilledWaterPlantLoop(Supply=[pumpvariable_3, branches_6, spscheduled_3], Demand=branches_7)

hvacsystemslist = Honeybee_HVACSystemsList({"-1. Thermostat Only": -1, "0. Ideal Air Loads": 0, "1. PTAC | Residential": 1, "2. PTHP | Residential": 2, "3. Packaged Single Zone - AC": 3, "4. Packaged Single Zone - HP": 4, "5. Packaged VAV w/ Reheat": 5, "6. Packaged VAV w/ PFP Boxes": 6, "7. VAV w/ Reheat": 7, "8. VAV w/ PFP Boxes": 8, "9. Warm Air Furnace - Gas Fired": 9, "10.Warm Air Furnace - Electric": 10, "11.Fan Coil Units + DOAS": 11, "12.Active Chilled Beams + DOAS": 12, "13.Radiant Floors + DOAS": 13, "14.Custom Rad Surfaces + DOAS": 14, "15.Heated Surfaces + VAV Cooling": 15, "16.VRF + DOAS": 16, "17.WSHP + DOAS": 17}, selected="7. VAV w/ Reheat")
merge_2 = Merge(Data1=hwloop, Data2=cwloop, Data3=dwloop)
hvacsystem = Ironbug_HVACSystem(AirLoops=flatten(airloop), PlantLoops=flatten(merge_2))
hvacsystem_2 = Honeybee_AssignHVACSystem(HBZones=glazingcreator.HBObjWGLZ, HVACSystems=hvacsystemslist)  # -> readMe, HBZones; plug-in component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
toggle = BooleanToggle(False)  # disabled
toggle_2 = BooleanToggle(False)
toggle_3 = BooleanToggle(False)
panel_8 = Panel("OPS_Sys")  # disabled
objviewer = Ironbug_ObjViewer()
exporttoopenstudio = Honeybee_ExportToOpenStudio(epwWeatherFile=epw_stat.epwFile, HBZones=flatten(glazingcreator.HBObjWGLZ), writeOSM=toggle, fileName=panel_8)  # -> readMe, osmFileAddress, idfFileAddress, resultFileAddress, eioFileAddress, rddFileAddress, htmlReport, studyFolder, model; disabled; plug-in component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
exporttoopenstudio_2 = Honeybee_ExportToOpenStudio(
    epwWeatherFile=epw_stat.epwFile,
    HBZones=flatten(hvacsystem_2.HBZones),
    writeOSM=toggle_3,
    openOpenStudio=toggle_3,
    fileName="HB_Sys")  # -> readMe, osmFileAddress, idfFileAddress, resultFileAddress, eioFileAddress, rddFileAddress, htmlReport, studyFolder, model; plug-in component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
exporttoopenstudio_3 = Honeybee_ExportToOpenStudio(
    epwWeatherFile=epw_stat.epwFile,
    HBZones=flatten(glazingcreator.HBObjWGLZ),
    HVACSystem=flatten(hvacsystem),
    writeOSM=toggle_2,
    openOpenStudio=toggle_2,
    fileName="IB_Sys")  # -> readMe, osmFileAddress, idfFileAddress, resultFileAddress, eioFileAddress, rddFileAddress, htmlReport, studyFolder, model; plug-in component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
readepresult = Honeybee_ReadEPResult(resultFileAddress=exporttoopenstudio_2.resultFileAddress)  # -> totalThermalLoad, thermalLoadBalance, cooling, heating, electricLight, electricEquip, fanElectric, pumpElectric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; plug-in component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
c_script = CSharpScript(x=exporttoopenstudio.osmFileAddress, Reference="C:\openstudio-2.5.0\CSharp\openstudio\OpenStudio.dll")  # -> out, A; inputs x: String; disabled
# ---------- c_script: C# ----------
    if (string.IsNullOrEmpty(x))
    {
      return;
    }

    var p = new OpenStudio.Path(x);
    var m_o = OpenStudio.Model.load(p);
    Print(m_o.is_initialized().ToString());
    var m = m_o.get();
    var zs = m.getThermalZones();
    foreach (OpenStudio.ThermalZone z in zs)
    {
      
      var eqps = z.equipment();
      foreach (var e in eqps)
      {
		 e.remove();
      }
    }
    OpenStudio.OpenStudioModelHVAC.addSystemType1(m, zs);

    m.save(p, true);
# ---------- end c_script ----------
c_script_2 = CSharpScript(x=exporttoopenstudio_3.osmFileAddress, Reference="C:\openstudio-2.5.0\CSharp\openstudio\OpenStudio.dll")  # -> out, A; inputs x: String; disabled
# ---------- c_script_2: C# ----------
    if (!string.IsNullOrEmpty(x))
    {
      var p = new OpenStudio.Path(x);
      var m = OpenStudio.Model.load(p).get();
      var plantLps = m.getPlantLoops();
      foreach (OpenStudio.PlantLoop pl in plantLps)
      {
        
        var tp = pl.sizingPlant().loopType();
        Print(pl.nameString() + "_" + tp);
      }
    }
# ---------- end c_script_2 ----------
panel_9 = Panel(exporttoopenstudio_3.osmFileAddress)
readepresult_2 = Honeybee_ReadEPResult(resultFileAddress=exporttoopenstudio_3.resultFileAddress)  # -> totalThermalLoad, thermalLoadBalance, cooling, heating, electricLight, electricEquip, fanElectric, pumpElectric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; plug-in component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
panel_10 = Panel(exporttoopenstudio.osmFileAddress)  # disabled
panel_11 = Panel(c_script.out)  # disabled
strnum = Ladybug_SeparateData(inputList=flatten(readepresult.cooling))  # -> numbers, strings; plug-in component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
strnum_2 = Ladybug_SeparateData(inputList=flatten(readepresult.heating))  # -> numbers, strings; plug-in component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
strnum_3 = Ladybug_SeparateData(inputList=flatten(readepresult_2.cooling))  # -> numbers, strings; plug-in component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
strnum_4 = Ladybug_SeparateData(inputList=flatten(readepresult_2.heating))  # -> numbers, strings; plug-in component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
ma = MassAddition(Input=flatten(strnum.numbers))  # -> Result, PartialResults
ma_2 = MassAddition(Input=strnum_2.numbers)  # -> Result, PartialResults
ma_3 = MassAddition(Input=strnum_3.numbers)  # -> Result, PartialResults
ma_4 = MassAddition(Input=strnum_4.numbers)  # -> Result, PartialResults
panel_12 = Panel(ma.Result)
panel_13 = Panel(ma_2.Result)
panel_15 = Panel(ma_4.Result)
panel_16 = Panel(ma_3.Result)

panel_18 = Panel("""1
0
0
0
0
0""")
cvbiquadratic = Ironbug_CurveBiquadratic(Coefficients=panel_18)
objparams_7 = Ironbug_ObjParams(EfficiencyCurveTemperatureEvaluationVariable="LeavingBoiler", NormalizedBoilerEfficiencyCurve=cvbiquadratic)

objparams_8 = Ironbug_ObjParams(PressureRise="300")
fanconstant = Ironbug_FanConstantVolume(Parameters=objparams_8)

timer = Timer(TimerInterval=1000)
list = ValueList({"One": 1, "Two": 2, "Three": 2² - 1, "Four": Sqrt(16)}, selected="One")
knob = ControlKnob(Decimals=2, Limit=True, Maximum=10, Minimum=0, Range=1, Value=1.03)
digit_scroller = DigitScroller(Scroller_Digits=12, Scroller_Radix=9, Scroller_Value=0.25)
item = CherryPicker(ListIndex=0)
gradient = Gradient(LowerLimit=0, UpperLimit=1, stops=[0.15: RGB(255, 130, 160), 0.85: RGB(220, 0, 40)])
dam = DataDam(BufferDelay=10000000, BufferMode=0)
nblur = BlurNumbers(Strength=0.5, Iterations=1, Lock=True, Wrap=False)
hvactemplate = Ironbug_HVACTemplate(_run=Button())
list_2 = ValueList({"One": 1, "Two": 2, "Three": 2² - 1, "Four": Sqrt(16)}, selected="One")

# ----
# PTHP
pthp = Ironbug_ZoneHVACPackagedTerminalHeatPump()

# ----
# HBZones
data_2 = Data()

thermalzone_2 = Ironbug_ThermalZone(HoneybeeZone=data_2, ZoneEquipments=pthp)
noairloop = Ironbug_NoAirLoop(OSZones=thermalzone_2)

hvacsystem_3 = Ironbug_HVACSystem(AirLoops=flatten(noairloop))
